# Grasshopper definition logical_thinking.gh (Grasshopper 1.0.7)
# Copyright: MIT License
# plug-ins: Bifocals, Kangaroo2 Components

# ---- group: Cluster
吸引子_点_线 = 吸引子点线()  # -> 连接线, 向量, 吸引子强度, 吸引子强度__0_1

# ---- group: Cluster Input
控制曲线 = 控制曲线()  # 由曲线建立吸引子。

控制点 = 控制点()  # 由点建立吸引子。

处理点组 = 处理点组()  # 处理点组

norm_y = Norm_y()  # Range of Influence for output Grid-Y direction。

# ---- group: Norm_y
norm_z = Norm_z()  # Range of Influence for output Grid-Z direction。

# ---- group: Cluster Input
nozerob = NoZeroB()  # noZeroB

nozerov = NoZeroV()  # noZeroV

sin_period = Sin_Period()  # 正弦函数周期。

sin_shift = Sin_Shift()  # 正弦函数偏移。

sin_amplitude = Sin_Amplitude()  # 正弦函数振幅。

minv = MinV()  # minV

# ----
nozerovalues = BooleanToggle(True)  # disabled
rangemin = Slider(5, range=0..120)  # disabled
nozerovalue = Slider(0.001, range=0.001..1)  # disabled
number_slider = Slider(0, range=-2..2)  # disabled
number_slider_2 = Slider(0, range=-2..2)  # disabled
number_slider_3 = Slider(1, range=-2..2)  # disabled
minvalue = Slider(1, range=0..100)  # disabled
curve = Curve(<curve referenced from the Rhino model>)  # disabled
geometry_pipeline = GeometryPipeline(
    GroupByLayer=False,
    GroupByType=False,
    IncludeHidden=True,
    IncludeLocked=True,
    LayerFilter="terrain_structureLines",
    NameFilter="*",
    SublayerFiltering=True,
    TypeFilter=4)  # disabled
rangemax = Slider(33, range=0..120)  # disabled
nozerovalues_2 = BooleanToggle(True)
nozerovalue_2 = Slider(0.001, range=0.001..1)
point = Point([Point(653.5112678, 23.37007294, 0), Point(653.3072203, 25.41054766, 0), Point(656.5719799, 27.19596303, 0), Point(655.8068018, 24.84941711, 0), Point(656.0618612, 16.58549451, 0)])
rectangle = Rectangle({Plane=PlaneXY(260.7413303, 83.51674865, 0), Size=Domain2(u=-74.40983185..74.40983185, v=-76.80388731..76.80388731)})
rangemax_2 = Slider(33.822, range=0..120)
rangemin_2 = Slider(5.623, range=0..120)
minvalue_2 = Slider(0, range=0..100)
人参考定位_随机旋转 = 人参考定位随机旋转(定位点=point, 旋转_seed=2)
attractorpointsgrid = Point([Point(397.3247361, 30.07956505, 0), Point(412.2647464, 73.11571411, 0), Point(396.4327952, 81.36616755, 0), Point(395.0948838, 59.29062996, 0), Point(419.8462442, 139.4730043, 0), Point(470.463891, 103.9183528, 0)])
point_2 = Point([Point(449.0622756, 22.01305814, 0), Point(446.6922058, 50.80940687, 0), Point(463.6382052, 64.20030154, 0), Point(496.7006797, 78.42072067, 0), Point(502.2703438, 97.73678997, 0), Point(507.603001, 123.4520479, 0)])
nozerovalues_3 = BooleanToggle(True)
rangemax_3 = Slider(33.822, range=0..120)
minvalue_3 = Slider(0, range=0..100)
rectangle_2 = Rectangle({Plane=PlaneXY(438.0195403, 86.16034996, 0), Size=Domain2(u=-77.71035205..77.71035205, v=-77.93333728..77.93333728)})
rangemin_3 = Slider(5.623, range=0..120)
nozerovalue_3 = Slider(0.001, range=0.001..1)
number_slider_4 = Slider(66, range=0..666)  # disabled
number_slider_5 = Slider(99, range=0..666)  # disabled
boundary_surfaces = BoundarySurfaces(Edges=rectangle)
point_3 = Point(处理点组)
pi = Pi(Factor=1)
boolean_toggle = BooleanToggle(True)  # disabled
button = Button()  # disabled
boolean_toggle_2 = BooleanToggle(True)  # disabled
number_slider_6 = Slider(0.4, range=0..1)  # disabled
number_slider_7 = Slider(0.35, range=0..9)  # disabled
number_slider_8 = Slider(0.9, range=0..1)  # disabled
panel = Panel("0")  # disabled
panel_2 = Panel("1")  # disabled
panel_3 = Panel("3")  # disabled
panel_4 = Panel("2")  # disabled
number_slider_9 = Slider(0.006, range=0..1)  # disabled
divide_surface = DivideSurface(Surface=rectangle, UCount=Slider(20, range=0..99), VCount=Slider(21, range=0..99))  # -> Points, Normals, Parameters
divide_surface_2 = DivideSurface(Surface=rectangle_2, UCount=Slider(20, range=0..99), VCount=Slider(21, range=0..99))  # -> Points, Normals, Parameters
interpolate = Interpolate(Vertices=point_2, Degree=3, Periodic=False, KnotStyle=1)  # -> Curve, Length, Domain
populate_geometry = PopulateGeometry(Geometry=boundary_surfaces, Count=Slider(334, range=0..999), Seed=Slider(2, range=0..222))
populate_geometry_2 = PopulateGeometry(Geometry=boundary_surfaces, Count=Slider(18, range=0..33), Seed=Slider(200, range=0..200))
boolean_toggle_3 = BooleanToggle(True)  # disabled
divide_surface_3 = DivideSurface(Surface=curve, UCount=number_slider_4, VCount=number_slider_5)  # -> Points, Normals, Parameters; disabled
curve_closest_point = CurveClosestPoint(Point=divide_surface_3.Points, Curve=curve)  # -> Point, Parameter, Distance; disabled
unit_z = UnitZ(Factor=1)  # disabled
curve_closest_point_2 = CurveCP(Point=graft(point_3), Curve=flatten(控制曲线))  # -> Point, Parameter, Distance
mesh_quad = MeshQuad(CornerA=panel, CornerB=panel_2, CornerC=panel_3, CornerD=panel_4)  # disabled
吸引子_点_线_2 = 吸引子点线()  # -> 连接线, 向量, 吸引子强度, 吸引子强度__0_1
multiplication = Multiplication(A=pi, B=sin_period)
multiplication_2 = Multiplication(A=pi, B=sin_shift)
multiplication_3 = Multiplication(A=pi, B=sin_amplitude)
flatten_tree = FlattenTree(Data=curve_closest_point_2.Point, Path="{0}")
merge = Merge(Data1=flatten_tree, Data2=控制点)
closest_point = ClosestPoint(Point=point_3, Cloud=flatten(merge))  # -> ClosestPoint, CPIndex, Distance
normalization_0_1 = GhPythonScript(x=closest_point.Distance, y=norm_y, z=norm_z, noZeroB=nozerob, noZeroV=nozerov)  # -> out, A; inputs noZeroB: Boolean; same code as normalization_0_1
手动调整更精准控制曲面变化的方法 = 手动调整更精准控制曲面变化的方法(
    控制曲线=interpolate.Curve,
    控制点=attractorpointsgrid,
    曲面点组=divide_surface_2.Points,
    norm_y=rangemax_3,
    norm_z=rangemin_3,
    nozerob=nozerovalues_3,
    nozerov=nozerovalue_3,
    sin_period=Slider(0.365, range=-2..2),
    sin_shift=Slider(0.321, range=-2..2),
    sin_amplitude=Slider(0.911, range=-2..2),
    minv=minvalue_3,
    curve_dash_length=Slider(1.591, range=0..9))  # -> 吸引子强度, 吸引子强度__0_1, u_curve, points, v_curve, u_v_dash
number_slider_10 = Slider(0.25, range=0..1)  # disabled
number_slider_11 = Slider(0.1, range=0..1)  # disabled
smaller_than = SmallerThan(FirstNumber=curve_closest_point.Distance, SecondNumber=number_slider_7)  # -> SmallerThan, OrEqualTo; disabled
clean_tree = CleanTree(RemoveNulls=boolean_toggle_3, RemoveInvalid=boolean_toggle_3, RemoveEmpty=boolean_toggle_3, Tree=divide_surface_3.Points)  # -> flatten(Tree); disabled

# ---- group: Cluster
吸引子_点_线_3 = 吸引子点线(
    控制曲线=geometry_pipeline,
    处理点组=clean_tree,
    norm_y=rangemax,
    norm_z=rangemin,
    nozerob=nozerovalues,
    nozerov=nozerovalue,
    sin_period=number_slider,
    sin_shift=number_slider_2,
    sin_amplitude=number_slider_3,
    minv=minvalue)  # -> 连接线, 向量, 吸引子强度, 吸引子强度__0_1; disabled

# ----
merge_2 = Merge(Data1=手动调整更精准控制曲面变化的方法.u_curve, Data2=手动调整更精准控制曲面变化的方法.v_curve)  # -> graft(Result)
boolean_toggle_4 = BooleanToggle(True)
boolean_toggle_5 = BooleanToggle(True)
load = Load(Point=clean_tree, ForceVector=unit_z, Weighting=number_slider_9)  # disabled
pts2meshquad = Pts2MeshQuad(TreeData=divide_surface_3.Points)  # -> out, simplify(PLst); inputs TreeData: tree of GeometryBase; disabled; same code as pts2meshquad
cull_pattern = CullPattern(List=divide_surface_3.Points, CullPattern=smaller_than.SmallerThan)  # disabled
clean_tree_2 = CleanTree(RemoveNulls=boolean_toggle, RemoveInvalid=boolean_toggle, RemoveEmpty=boolean_toggle, Tree=cull_pattern)  # disabled
construct_mesh = ConstructMesh(Vertices=pts2meshquad.PLst, Faces=mesh_quad)  # disabled
mesh_join = MeshJoin(Meshes=flatten(construct_mesh))  # disabled
edgelengths = EdgeLengths(Mesh=mesh_join, LengthFactor=number_slider_6, Strength=number_slider_8)  # disabled
random_points_sine = RandomPoints_Sine(
    cutoff=Slider(1.28, range=-2..2),
    seed=Slider(96, range=0..222),
    points=populate_geometry,
    cloud=populate_geometry_2,
    sin_period=Slider(19.748, range=0..200),
    sin_shift=Slider(0, range=0..200))  # -> random_points, domain
手动调整更精准控制曲面变化的方法_2 = 手动调整更精准控制曲面变化的方法(
    控制点=random_points_sine.random_points,
    曲面点组=divide_surface.Points,
    norm_y=rangemax_2,
    norm_z=rangemin_2,
    nozerob=nozerovalues_2,
    nozerov=nozerovalue_2,
    sin_period=Slider(0.365, range=-2..2),
    sin_shift=Slider(0.321, range=-2..2),
    sin_amplitude=Slider(0.911, range=-2..2),
    minv=minvalue_2,
    curve_dash_length=Slider(1.591, range=0..9))  # -> 吸引子强度, 吸引子强度__0_1, u_curve, points, v_curve, u_v_dash
merge_3 = Merge(Data1=手动调整更精准控制曲面变化的方法_2.u_curve, Data2=手动调整更精准控制曲面变化的方法_2.v_curve)  # -> graft(Result)
anchor = Anchor(Point=clean_tree_2, Strength=10000)  # disabled
line = Line(StartPoint=point_3, EndPoint=closest_point.ClosestPoint)
sin = GhPythonScript(values=normalization_0_1.A, sin_period=multiplication, sin_shift=multiplication_2, sin_amplitude=multiplication_3)  # -> out, sin_y; inputs values: list; same code as sin
show = Show(G=mesh_join)  # disabled
vector_2pt = Vector2Pt(PointA=point_3, PointB=closest_point.ClosestPoint, Unitize=True)  # -> Vector, Length
minimum_limit = GhPythonScript(x=sin.sin_y, minV=minv, noZeroB=nozerob, noZeroV=nozerov)  # -> out, A; inputs noZeroB: Boolean; same code as minimum_limit
numoutput = Number(minimum_limit.A)
bounds = Bounds(Numbers=flatten(numoutput))
remap_numbers = RemapNumbers(Value=numoutput, Source=bounds, Target="0 to 1")  # -> Mapped, Clipped
曲线双侧偏移 = 曲线双侧偏移(curve=merge_3, plane=PlaneXY(0, 0, 0), distance_1=Slider(0.363, range=0..1), 是否等宽=0)
曲线双侧偏移_2 = 曲线双侧偏移(curve=merge_2, plane=PlaneXY(0, 0, 0), distance_1=Slider(0.363, range=0..1), 是否等宽=0)
multiplication_4 = Multiplication(A=吸引子_点_线_3.吸引子强度__0_1, B=number_slider_10)  # disabled
amplitude = Amplitude(Vector=吸引子_点_线_3.向量, Amplitude=multiplication_4)  # disabled
load_2 = Load(Point=clean_tree, ForceVector=amplitude, Weighting=number_slider_11)  # disabled
entwine = Entwine(Branch00=edgelengths, Branch01=anchor, Branch02=show, Branch03=load, Branch04=load_2, FlattenInputs=True)  # disabled
solver = Solver(GoalObjects=entwine, Reset=button, Threshold=1e-15, Tolerance=0.0001, On=boolean_toggle_2)  # -> I, V, O; disabled
explode_tree = ExplodeTree(Data=solver.O)  # -> Branch0, Branch1, Branch2, Branch3, Branch4; disabled
mesh = Mesh(explode_tree.Branch2)  # disabled
trim_tree = TrimTree(Tree=曲线双侧偏移, Depth=1)
loft = Loft(Curves=trim_tree, Options={Adjust=False, Closed=False, LoftEnds=0, LoftSimp=0, LoftType=0, Rebuild=10, Refit=0.01})
clean_tree_3 = CleanTree(RemoveNulls=boolean_toggle_4, RemoveInvalid=boolean_toggle_4, RemoveEmpty=boolean_toggle_4, Tree=loft)
solid_union = SolidUnion(Breps=clean_tree_3)
trim_tree_2 = TrimTree(Tree=曲线双侧偏移_2, Depth=1)
loft_2 = Loft(Curves=trim_tree_2, Options={Adjust=False, Closed=False, LoftEnds=0, LoftSimp=0, LoftType=0, Rebuild=10, Refit=0.01})
clean_tree_4 = CleanTree(RemoveNulls=boolean_toggle_5, RemoveInvalid=boolean_toggle_5, RemoveEmpty=boolean_toggle_5, Tree=loft_2)
solid_union_2 = SolidUnion(Breps=clean_tree_4)

# ---- group: Cluster Output
吸引子强度__0_1 = 吸引子强度_01(remap_numbers.Mapped)  # 将吸引子强度映射到［０，１］值域。

吸引子强度 = 吸引子强度(minimum_limit.A)  # 吸引子强度。

向量 = 向量(vector_2pt.Vector)  # 处理点组与控制点和点组到控制曲线最近点的单元向量。

连接线 = 连接线(line)  # 处理点组与控制点和点组到控制曲线最近点的连线。

# ---- group: Cluster
辅助地形设计_kangaroo = 辅助地形设计Kangaroo(吸引子_load_weighting=1, z_up_load_weighting=1, u_count=10, v_count=10, mesh_lengthfactor=1, mesh_strength=1, 边界点控制距离=0)  # -> 边界固定点, goalobjects

# ---- group: Cluster Input
控制曲线_2 = 控制曲线()  # 由曲线建立吸引子。

控制点_2 = 控制点()  # 由点建立吸引子。

norm_y_2 = Norm_y()  # Range of Influence for output Grid-Y direction。

# ---- group: Norm_y
norm_z_2 = Norm_z()  # Range of Influence for output Grid-Z direction。

# ---- group: Cluster Input
nozerob_2 = NoZeroB()  # noZeroB

nozerov_2 = NoZeroV()  # noZeroV

sin_period_2 = Sin_Period()  # 正弦函数周期。

sin_shift_2 = Sin_Shift()  # 正弦函数偏移。

sin_amplitude_2 = Sin_Amplitude()  # 正弦函数振幅。

minv_2 = MinV()  # minV

吸引子向量倍数 = 吸引子向量倍数()  # 吸引子向量倍数

吸引子_load_weighting = 吸引子Load_Weighting()  # 吸引子-Load_Weighting

z_up_load_weighting = Z_up_Load_Weighting()  # Z_up_Load_Weighting

地形边界 = 地形边界()  # 地形边界

u_count = UCount()  # U Count

v_count = VCount()  # V Count

mesh_lengthfactor = Mesh_LengthFactor()  # Mesh_LengthFactor

mesh_strength = Mesh_Strength()  # Mesh_Strength

边界点控制距离 = 边界点控制距离()  # 边界点控制距离

# ----
geometry_pipeline_2 = GeometryPipeline(
    GroupByLayer=False,
    GroupByType=False,
    IncludeHidden=True,
    IncludeLocked=True,
    LayerFilter="terrain_structureLines",
    NameFilter="*",
    SublayerFiltering=True,
    TypeFilter=4)
rangemax_4 = Slider(33, range=0..120)
rangemin_4 = Slider(5, range=0..120)
nozerovalues_4 = BooleanToggle(True)
nozerovalue_4 = Slider(0.001, range=0.001..1)
minvalue_4 = Slider(0, range=0..100)
curve_2 = Curve(<curve referenced from the Rhino model>)
run = BooleanToggle(False)
reset = Button()
point_4 = Point([Point(32.30030379, 11.78102463, 0), Point(31.87822186, 12.22320569, 0), Point(33.22486419, 13.06736954, 0), Point(31.69732961, 16.10233957, 0), Point(32.05911412, 17.60977502, 0), Point(31.87822186, 20.3633571, 0)])
number_slider_12 = Slider(0.353, range=0..1)
point_5 = Point([Point(6.046264015, 3.21108325, 0), Point(6.046264015, 58.90963587, 0), Point(31.2604511, 58.90963587, 0), Point(31.2604511, 3.65887619, 0)])
辅助地形设计_kangaroo_2 = 辅助地形设计Kangaroo(吸引子_load_weighting=1, z_up_load_weighting=1, u_count=10, v_count=10, mesh_lengthfactor=1, mesh_strength=1, 边界点控制距离=0)  # -> 边界固定点, goalobjects
人参考定位_随机旋转_2 = 人参考定位随机旋转(定位点=point_4, 旋转_seed=2)
boolean_toggle_6 = BooleanToggle(True)
boolean_toggle_7 = BooleanToggle(True)
divide_surface_4 = DivideSurface(Surface=地形边界, UCount=u_count, VCount=v_count)  # -> Points, Normals, Parameters
unit_z_2 = UnitZ(Factor=1)
curve_closest_point_3 = CurveClosestPoint(Point=divide_surface_4.Points, Curve=地形边界)  # -> Point, Parameter, Distance
mesh_quad_2 = MeshQuad(CornerA="0", CornerB="1", CornerC="3", CornerD="2")
construct_domain = ConstructDomain(DomainStart=Slider(-1.403, range=-5..12), DomainEnd=Slider(11.469, range=0..100))
construct_domain_2 = ConstructDomain(DomainStart=Slider(-1.403, range=-5..12), DomainEnd=Slider(20, range=0..100))
polyline = PolyLine(Vertices=point_5, Closed=Toggle(True))
counter = Counter(Run=run, Reset=reset, step=Slider(1, range=0..1), Target=Slider(5, range=1..5), Interval=Slider(20, range=1..1000))  # -> Counter; inputs Run: Boolean
# ---------- counter: Python ----------
"""Provides a scripting component.
    Inputs:
        Run: 执行计数。
        Reset: 重设。
        step: 计数步幅。
        Target: 计数终止值。
        Interval: 时间间隔。
    Output:
        Counter: 计数变化值"""
        
        
        
ghenv.Component.Name = 'Counter'
ghenv.Component.NickName = 'Counter'
ghenv.Component.Description = '动态计数'
ghenv.Component.Message = '0.0.1'
ghenv.Component.Category = 'Moths'
ghenv.Component.SubCategory = 'Data Organization'
ghenv.Component.AdditionalHelpFromDocStrings = '1'
        
import Grasshopper as gh

def updateComponent(interval):
    
    """ Update this component similar to using a grasshopper timer """
    
    def callBack(e):
        ghenv.Component.ExpireSolution(False)
        
    ghenv.Component.OnPingDocument().ScheduleSolution(interval,
    gh.Kernel.GH_Document.GH_ScheduleDelegate(callBack))

# Instantiate or reset persistent counter variable
if "count" not in globals() or Reset:
    count = 0

# Update the variable and component
if Run and not Reset and count < Target:
    count +=step
    updateComponent(Interval)

# Output counter
Counter = count
# ---------- end counter ----------
merge_4 = Merge(Data1=number_slider_12, Data2=number_slider_12)
辅助地形设计_kangaroo_3 = 辅助地形设计Kangaroo(
    控制曲线=geometry_pipeline_2,
    norm_y=rangemax_4,
    norm_z=rangemin_4,
    nozerob=nozerovalues_4,
    nozerov=nozerovalue_4,
    sin_period=Slider(0, range=-2..2),
    sin_shift=Slider(0, range=-2..2),
    sin_amplitude=Slider(1, range=-2..2),
    minv=minvalue_4,
    吸引子向量倍数=Slider(0.25, range=0..1),
    吸引子_load_weighting=Slider(0.1, range=0..1),
    z_up_load_weighting=Slider(0.006, range=0..1),
    地形边界=curve_2,
    u_count=Slider(66, range=0..666),
    v_count=Slider(99, range=0..666),
    mesh_lengthfactor=Slider(0.4, range=0..1),
    mesh_strength=Slider(0.9, range=0..1),
    边界点控制距离=Slider(0.35, range=0..9))  # -> 边界固定点, goalobjects
smaller_than_2 = SmallerThan(FirstNumber=curve_closest_point_3.Distance, SecondNumber=边界点控制距离)  # -> SmallerThan, OrEqualTo
clean_tree_5 = CleanTree(RemoveNulls=boolean_toggle_6, RemoveInvalid=boolean_toggle_6, RemoveEmpty=boolean_toggle_6, Tree=divide_surface_4.Points)  # -> flatten(Tree)

# ---- group: Cluster
吸引子_点_线_4 = 吸引子点线(
    控制曲线=控制曲线_2,
    控制点=控制点_2,
    处理点组=clean_tree_5,
    norm_y=norm_y_2,
    norm_z=norm_z_2,
    nozerob=nozerob_2,
    nozerov=nozerov_2,
    sin_period=sin_period_2,
    sin_shift=sin_shift_2,
    sin_amplitude=sin_amplitude_2,
    minv=minv_2)  # -> 连接线, 向量, 吸引子强度, 吸引子强度__0_1

# ----
load_3 = Load(Point=clean_tree_5, ForceVector=unit_z_2, Weighting=z_up_load_weighting)
pts2meshquad_2 = Pts2MeshQuad(TreeData=divide_surface_4.Points)  # -> out, simplify(PLst); inputs TreeData: tree of GeometryBase; same code as pts2meshquad
cull_pattern_2 = CullPattern(List=divide_surface_4.Points, CullPattern=smaller_than_2.SmallerThan)
clean_tree_6 = CleanTree(RemoveNulls=boolean_toggle_7, RemoveInvalid=boolean_toggle_7, RemoveEmpty=boolean_toggle_7, Tree=cull_pattern_2)
construct_mesh_2 = ConstructMesh(Vertices=pts2meshquad_2.PLst, Faces=mesh_quad_2)
mesh_join_2 = MeshJoin(Meshes=flatten(construct_mesh_2))
edgelengths_2 = EdgeLengths(Mesh=mesh_join_2, LengthFactor=mesh_lengthfactor, Strength=mesh_strength)
panel_5 = Panel(counter)
solver_2 = Solver(GoalObjects=辅助地形设计_kangaroo_3.goalobjects, Reset=Button(), Threshold=1e-15, Tolerance=0.0001, On=Toggle(False))  # -> I, V, O
anchor_2 = Anchor(Point=clean_tree_6, Strength=10000)
explode_tree_2 = ExplodeTree(Data=solver_2.O)  # -> Branch0, Branch1, Branch2, Branch3, Branch4
face_normals = FaceNormals(Mesh=explode_tree_2.Branch2)  # -> Centers, Normals
points_to_numbers = PointsToNumbers(Points=face_normals.Centers, Mask=4)
地形构建_重分类可视化 = 地形构建重分类可视化(高程点_列表=points_to_numbers, 等高线间距=Slider(0.25, range=0..1))  # -> 等高线, 高程点, 地形表面, 图例颜色, 图例标签
show_2 = Show(G=mesh_join_2)
dash_pattern = DashPattern(Curve=polyline, Pattern=merge_4)  # -> Dashes, Gaps
curve_3 = Curve(地形构建_重分类可视化.等高线)
multiplication_5 = Multiplication(A=吸引子_点_线_4.吸引子强度__0_1, B=吸引子向量倍数)
amplitude_2 = Amplitude(Vector=吸引子_点_线_4.向量, Amplitude=multiplication_5)
load_4 = Load(Point=clean_tree_5, ForceVector=amplitude_2, Weighting=吸引子_load_weighting)
mesh_2 = Mesh(explode_tree_2.Branch2)
entwine_2 = Entwine(Branch00=edgelengths_2, Branch01=anchor_2, Branch02=show_2, Branch03=load_3, Branch04=load_4, FlattenInputs=True)
point_6 = Point(辅助地形设计_kangaroo_3.边界固定点)

# ---- group: Cluster Output
goalobjects = GoalObjects(entwine_2)  # GoalObjects

# ----
地形生成_磁场 = 地形生成磁场(
    设计边界=polyline,
    磁力线控制边界偏移=Slider(1.981, range=0..12),
    磁力线控制点_数量=Slider(48, range=0..100),
    磁力线控制点_seed=Slider(13, range=0..100),
    aco_domain_start=Slider(-9.14, range=-100..100),
    aco_domain_end=Slider(4.696, range=-90..200),
    aco_seed=Slider(100, range=0..100),
    控制折线强度=Slider(9.697, range=0..100),
    边界点数=Slider(40, range=0..1000),
    控制点强度区间=construct_domain,
    控制点衰减区间=construct_domain_2,
    控制点强度区间_seed=Slider(49.859, range=0..100),
    控制点衰减_seed=Slider(49.859, range=0..100),
    populate_pts_count=Slider(2000, range=0..9000),
    populate_pts_seed=Slider(54, range=0..100),
    磁力倍数=Slider(1.865, range=0..10),
    光滑地形=Slider(0.796, range=0..1.5),
    等高线距离=Slider(0.2, range=0..1),
    抬升地形=Slider(0.718, range=0..1))  # -> 地形表面, 等高线, 高程点
points_to_numbers_2 = PointsToNumbers(Points=graft(地形生成_磁场.高程点), Mask=4)
地形构建_重分类可视化_2 = 地形构建重分类可视化(高程点_列表=points_to_numbers_2, 等高线间距=Slider(0.1, range=0..20), 重分类高程=Slider(0.2, range=0..20))  # -> 等高线, 高程点, 地形表面, 图例颜色, 图例标签
高程值标注_随机位置 = 高程值标注随机位置(等高线=地形构建_重分类可视化_2.等高线, 高程点位置_seed=Slider(2294, range=0..9000))  # -> points, z值
panel_6 = Panel(points_to_numbers_2)
dot_display = DotDisplay(Point=高程值标注_随机位置.points, Colour=RGB(0, 0, 0), Size=Slider(0.1, range=0..1))
text_tag_3d = TextTag3D(Location=高程值标注_随机位置.points, Text=高程值标注_随机位置.z值, Size=Slider(0.277, range=0..1), Justification=7)
flatten_tree_2 = FlattenTree(Tree=地形生成_磁场.等高线, Path="{0}")
evaluate_length = EvaluateLength(Curve=地形生成_磁场.等高线, Length=0, Normalized=True)  # -> Point, Tangent, Parameter
deconstruct = Deconstruct(Point=evaluate_length.Point)  # -> XComponent, YComponent, ZComponent
rectangle_3 = Rectangle({Plane=PlaneXY(33.8311742, 51.52919926, 0), Size=Domain2(u=-1.90150585..1.90150585, v=-7.186380731..7.186380731)})
curve_4 = Curve(地形构建_重分类可视化_2.等高线)
legend = Legend(Colour=地形构建_重分类可视化_2.图例颜色, Tags=地形构建_重分类可视化_2.图例标签, Rectangle=rectangle_3, LegendType=1)
list_item = ListItem(List=flatten(地形生成_磁场.等高线), Index=Slider(16, range=0..100), Wrap=True)
mesh_3 = Mesh(地形构建_重分类可视化_2.地形表面)
k_v_threshold = K_V_Threshold(
    Keys=flatten(deconstruct.ZComponent),
    x=Slider(-0.15, range=-2.001..2),
    Values=flatten(flatten_tree_2),
    Threshold=Slider(0.034, range=-2.001..2))  # -> out, Values_x; inputs Keys: list, Values: list
# ---------- k_v_threshold: Python ----------
"""Provides a scripting component.
    Inputs:
        Mesh: 待展平的Mesh对象
        LocationPoint: 展平位置定位点，需要3个点
    Output:
        FlattenMeshes: 展平的Mesh对象"""

__author__ = "Richie Bao-西建大-山水比德产学研合作项目（参数化设计数字技术示范课程建设）"
__version__ = "2022.01.01"

ghenv.Component.Name = 'K_V_Threshold'
ghenv.Component.NickName = 'K_V_Threshold'
ghenv.Component.Description = '给定键值（Keys, Values）对，根据键的值，是否在x-Threshold和x+Threshold之间，提取Values值。'
ghenv.Component.Message = '0.0.1'
ghenv.Component.Category = 'Moths'
ghenv.Component.SubCategory = 'Data Organization'
ghenv.Component.AdditionalHelpFromDocStrings = '1'

__author__ = "richie bao"
__version__ = "2022.01.01"

import rhinoscriptsyntax as rs

Values_x=[Values[i] for i in range(len(Keys)) if x>=Keys[i]-Threshold and x<=Keys[i]+Threshold]
# ---------- end k_v_threshold ----------
boundary_surfaces_2 = BoundarySurfaces(Edges=k_v_threshold.Values_x)
mesh_4 = Mesh(地形生成_磁场.地形表面)
point_7 = Point(地形生成_磁场.高程点)
curve_5 = Curve(地形生成_磁场.等高线)

# ==== cluster 手动调整更精准控制曲面变化的方法: 手动调整更精准控制曲面变化的方法。

# ---- group: Cluster Input
控制曲线 = ClusterInput()  # 由曲线建立吸引子。

控制点 = ClusterInput()  # 由点建立吸引子。

曲面点组 = ClusterInput()  # 待变化曲面提取的UV点，或者类似数据结构的点组。

norm_y = ClusterInput()  # Range of Influence for output Grid-Y direction。

# ---- group: Norm_y
norm_z = ClusterInput()  # Range of Influence for output Grid-Z direction。

# ---- group: Cluster Input
nozerob = ClusterInput()  # noZeroB

nozerov = ClusterInput()  # noZeroV

sin_period = ClusterInput()  # 正弦函数周期。

sin_shift = ClusterInput()  # 正弦函数偏移。

sin_amplitude = ClusterInput()  # 正弦函数振幅。

minv = ClusterInput()  # minV

curve_dash_length = ClusterInput()  # 受吸引子影响变化点组的UV曲线，虚线表达间隔。

# ----
point = Point(曲面点组)
merge = Merge(Data1=curve_dash_length, Data2=curve_dash_length)
degree = Slider(1, range=1..3)
degree_2 = Slider(1, range=1..3)
pi = Pi(Factor=1)
curve_closest_point = CurveCP(Point=graft(point), Curve=flatten(控制曲线))  # -> Point, Parameter, Distance
multiplication = Multiplication(A=pi, B=sin_period)
multiplication_2 = Multiplication(A=pi, B=sin_shift)
multiplication_3 = Multiplication(A=pi, B=sin_amplitude)
flatten_tree = FlattenTree(Data=curve_closest_point.Point, Path="{0}")
merge_2 = Merge(Data1=flatten_tree, Data2=控制点)
closest_point = ClosestPoint(Point=point, Cloud=flatten(merge_2))  # -> ClosestPoint, CPIndex, Distance
normalization_0_1 = GhPythonScript(x=closest_point.Distance, y=norm_y, z=norm_z, noZeroB=nozerob, noZeroV=nozerov)  # -> out, A; inputs noZeroB: Boolean
# ---------- normalization_0_1: Python ----------
"""Provides a scripting component. original code:http://object-e.net/tools/attractorfields-tools-gh
    Inputs:
        x: The x script variable
        y: The y script variable
    Output:
        a: The a output variable"""

__author__ = "richie bao" 
__version__ = "2022.03.10"

import rhinoscriptsyntax as rs

def Normalization_0to1(x,y,z,noZeroB,noZeroV):
    if x > z:
      if x < y:
        b = x / y
      else:
        b = 1
    else:
      b = 0
    if noZeroB:
      if b == 0:
        A = noZeroV
      else:
        A = b
    else:
      A = b
      
    return A

A=Normalization_0to1(x,y,z,noZeroB,noZeroV)
# ---------- end normalization_0_1 ----------
line = Line(StartPoint=point, EndPoint=closest_point.ClosestPoint)
sin = GhPythonScript(values=normalization_0_1.A, sin_period=multiplication, sin_shift=multiplication_2, sin_amplitude=multiplication_3)  # -> out, sin_y; inputs values: list
# ---------- sin: Python ----------
__author__ = "richi"
__version__ = "2022.03.11"

import rhinoscriptsyntax as rs
import math

sin_y=[]
for v in values:    
    if sin_amplitude:
        sin_y.append(sin_amplitude*math.sin((1/sin_period)*v+math.pi/2+sin_shift))
    else:
        sin_y.append(math.sin((1/sin_period)*v+math.pi/2+sin_shift))
# ---------- end sin ----------
minimum_limit = GhPythonScript(x=sin.sin_y, minV=minv, noZeroB=nozerob, noZeroV=nozerov)  # -> out, A; inputs noZeroB: Boolean
# ---------- minimum_limit: Python ----------
"""Provides a scripting component. original code:http://object-e.net/tools/attractorfields-tools-gh
    Inputs:
        x: The x script variable
        y: The y script variable
    Output:
        a: The a output variable"""

__author__ = "richie bao"
__version__ = "2022.03.10"

import rhinoscriptsyntax as rs

def Minimum_limit(x,minV,noZeroB,noZeroV):
    if x < minV:
      b = minV
    else:
      b = x
    if noZeroB:
      if b == 0:
        A = noZeroV
      else:
        A = b
    else:
      A = b
    return A
    
A=Minimum_limit(x,minV,noZeroB,noZeroV)
# ---------- end minimum_limit ----------
numoutput = Number(minimum_limit.A)
bounds = Bounds(Numbers=flatten(numoutput))
remap_numbers = RemapNumbers(Value=numoutput, Source=bounds, Target="0 to 1")  # -> Mapped, Clipped
evaluate_curve = EvaluateCurve(Curve=line, Parameter=remap_numbers.Mapped)  # -> Point, Tangent, Angle

# ---- group: Cluster Output
points = ClusterOutput(evaluate_curve.Point)

# ----
flip_matrix = FlipMatrix(Data=evaluate_curve.Point)
interpolate = Interpolate(Vertices=flip_matrix, Degree=degree, Periodic=False, KnotStyle=0)  # -> Curve, Length, Domain
interpolate_2 = Interpolate(Vertices=evaluate_curve.Point, Degree=degree_2, Periodic=False, KnotStyle=0)  # -> Curve, Length, Domain

# ---- group: Cluster Output
u_curve = ClusterOutput(interpolate.Curve)  # 变化后点组U向曲线。

# ----
merge_3 = Merge(Data1=interpolate.Curve, Data2=interpolate_2.Curve)
dash_pattern = DashPattern(Curve=merge_3, Pattern=merge)  # -> Dashes, Gaps

# ---- group: U-Curve
v_curve = ClusterOutput(interpolate_2.Curve)  # 变化后点组V向曲线。

# ----
u_v_dash = ClusterOutput(dash_pattern.Dashes)  # UV向曲线的虚线表达。

# ---- group: Cluster Output
吸引子强度__0_1 = ClusterOutput(remap_numbers.Mapped)  # 将吸引子强度映射到［０，１］值域。

吸引子强度 = ClusterOutput(minimum_limit.A)  # 吸引子强度。

# ==== cluster 曲线双侧偏移: 两侧偏移曲线，可以等宽或不等宽。
plane = ClusterInput()  # Plane for offset operation.

# ---- group: Cluster Input
distance_1 = ClusterInput()  # 一侧偏移距离。

distance_2 = ClusterInput()  # 另一侧偏移距离。

是否等宽 = ClusterInput()  # 两侧偏移距离是否保持相同。

# ----
negative = Negative(Value=distance_1)
negative_2 = Negative(Value=distance_2)

# ---- group: Cluster Input
curve = ClusterInput()  # 待偏移曲线。

# ----
stream_filter = StreamFilter(Gate=是否等宽, Stream0=negative, Stream1=negative_2)
merge = Merge(Data1=distance_1, Data2=stream_filter)
offset_curve = OffsetCurve(Curve=curve, Distance=merge, Plane=plane, Corners=1)  # -> simplify(Curve)

# ---- group: Cluster Output
offset_curves = ClusterOutput(offset_curve)  # 偏移后的曲线。

# ==== cluster RandomPoints_Sine: 经过正弦变换后的点云数据。

# ---- group: Cluster Input
cutoff = ClusterInput()  # 比较给定数值，移除小于该值的数值。

seed = ClusterInput()  # If True, the length factor is nomorlized [0,1]。

points = ClusterInput()  # 控制点位置。

cloud = ClusterInput()  # 点云。

sin_period = ClusterInput()  # 正弦函数周期。

sin_shift = ClusterInput()  # 正弦函数偏移。

sin_amplitude = ClusterInput()  # 正弦函数振幅。

# ----
flatten_tree = FlattenTree(Tree=points, Path="{0}")
list_length = ListLength(List=flatten_tree)
closest_point = ClosestPoint(Point=flatten_tree, Cloud=cloud)  # -> ClosestPoint, CPIndex, Distance
random = Random(Range="-0.5 to +0.5", Number=list_length, Seed=seed)
sin = GhPythonScript(values=closest_point.Distance, sin_period=sin_period, sin_shift=sin_shift, sin_amplitude=sin_amplitude)  # -> out, sin_y; inputs values: list; same code as sin
addition = Addition(A=random, B=sin.sin_y)
larger_than = LargerThan(FirstNumber=addition, SecondNumber=cutoff)  # -> LargerThan, OrEqualTo
bounds = Bounds(Numbers=sin.sin_y)
cull_pattern = CullPattern(List=flatten_tree, CullPattern=larger_than.LargerThan)

# ---- group: Cluster Output
domain = ClusterOutput(bounds)  # 经过正弦变化后，控制点到点云的距离区间。

random_points = ClusterOutput(cull_pattern)  # 产生具有变化关系的点云。

# ==== cluster 地形生成磁场: 地形生成-磁场

# ---- group: Cluster Input
设计边界 = ClusterInput()  # 设计边界

磁力线控制边界偏移 = ClusterInput()  # 磁力线控制边界偏移

磁力线控制点_数量 = ClusterInput()  # 磁力线控制点-数量

磁力线控制点_seed = ClusterInput()  # 磁力线控制点-Seed

aco_domain_start = ClusterInput()  # ACO-domain start

# ---- group: ACO-domain start
aco_domain_end = ClusterInput()  # ACO-domain end

# ---- group: Cluster Input
aco_seed = ClusterInput()  # ACO-Seed

# ----
控制折线强度 = ClusterInput()  # 输入数值，控制脊线起伏程度。

# ---- group: Cluster Input
边界点数 = ClusterInput()  # 边界点数

# ----
地形山顶_山谷 = ClusterInput()  # 可选项，输入一个或者多个点控制地形山顶(山谷)。
控制点强度区间 = ClusterInput()  # 输入一维区间值。

# ---- group: 控制点强度区间
控制点衰减区间 = ClusterInput()  # 输入一维区间值。

控制点强度区间_seed = ClusterInput()  # 输入一维区间值。

# ---- group: Cluster Input
控制点衰减_seed = ClusterInput()  # 控制点衰减-Seed

# ---- group: 精度
populate_pts_count = ClusterInput()  # 输入数量，控制地形精度。

# ---- group: Cluster Input
populate_pts_seed = ClusterInput()  # Populate Pts-Seed

# ----
光滑地形 = ClusterInput()  # 输入迭代次数，柔化地形。
等高线距离 = ClusterInput()  # 输入等高线距离值。

# ---- group: up terrain
抬升地形 = ClusterInput()  # 抬升地形

# ----
磁力倍数 = ClusterInput()  # 输入数值控制地形变化程度。

offset_curve = OffsetCurve(Curve=设计边界, Distance=磁力线控制边界偏移, Plane=PlaneXY(0, 0, 0), Corners=1)
boundary_surfaces = BoundarySurfaces(Edges=offset_curve)
populate_geometry = PopulateGeometry(Geometry=boundary_surfaces, Count=磁力线控制点_数量, Seed=磁力线控制点_seed)
aco = PythonScript(Cities=populate_geometry, antCount="20", nMax="20", run=Toggle(True))  # -> out, Route; inputs Cities: list
# ---------- aco: Python ----------
import rhinoscriptsyntax as rs
import os
import sys
import sets
import random
import string
from string import *
from math import *
BestTour = []                   
CitySet = sets.Set()            
CityList = []                   
PheromoneTrailList = []         
PheromoneDeltaTrailList = []    
CityDistanceList = []           
AntList = []                    
BTC=[]
    
class BACA:
    def __init__(self, cityCount=14, antCount=10, q=80,
                 alpha=2, beta=5, rou=0.3, nMax=10):
        self.CityCount = cityCount
        self.AntCount = antCount
        self.Q = q
        self.Alpha = alpha
        self.Beta = beta
        self.Rou = rou
        self.Nmax = nMax
        self.Shortest = 10e6
        random.seed()
        for nCity in range(self.CityCount):
            BestTour.append(0)
        for row in range(self.CityCount):
            pheromoneList = []
            pheromoneDeltaList = []
            for col in range(self.CityCount):
                pheromoneList.append(100)              
                pheromoneDeltaList.append(0)            
            PheromoneTrailList.append(pheromoneList)
            PheromoneDeltaTrailList.append(pheromoneDeltaList)
        
    def ReadCityInfo(self, fileName):
        for i in fileName.keys():
            cityN, cityX, cityY = i,fileName[i][1],fileName[i][2]
            CitySet.add(int(cityN))               
            CityList.append((int(cityN),float(cityX),float(cityY)))
        for row in range(self.CityCount):
            distanceList = []
            for col in range(self.CityCount):
                distance = sqrt(pow(CityList[row][1]-CityList[col][1],2)+pow(CityList[row][2]-CityList[col][2],2))
                distanceList.append(distance)
            CityDistanceList.append(distanceList)

    def PutAnts(self):
        for antNum in range(self.AntCount):
            city = random.randint(1, self.CityCount)
            ant = ANT(city)
            AntList.append(ant)
    def Search(self):
        for iter in range(self.Nmax):
            self.PutAnts()
            for ant in AntList:
                for ttt in range(len(CityList)):
                    ant.MoveToNextCity(self.Alpha, self.Beta)
                ant.UpdatePathLen()
            tmpLen = AntList[0].CurrLen
            tmpTour = AntList[0].TabuCityList
            for ant in AntList[1:]:
                if ant.CurrLen < tmpLen:
                    tmpLen = ant.CurrLen
                    tmpTour = ant.TabuCityList
            if tmpLen < self.Shortest:
                self.Shortest = tmpLen
                BestTour = tmpTour
            print (iter,":",self.Shortest,":",BestTour)
            BTC.append(BestTour)
            self.UpdatePheromoneTrail()


    def UpdatePheromoneTrail(self):
        for ant in AntList:
            for city in ant.TabuCityList[0:-1]:
                idx = ant.TabuCityList.index(city)
                nextCity = ant.TabuCityList[idx+1]
                PheromoneDeltaTrailList[city-1][nextCity-1] = self.Q/ant.CurrLen
                PheromoneDeltaTrailList[nextCity-1][city-1] = self.Q/ant.CurrLen
            lastCity = ant.TabuCityList[-1]
            firstCity = ant.TabuCityList[0]
            PheromoneDeltaTrailList[lastCity-1][firstCity-1] = self.Q/ant.CurrLen
            PheromoneDeltaTrailList[firstCity-1][lastCity-1] = self.Q/ant.CurrLen
        for (city1,city1X,city1Y) in CityList:
            for (city2,city2X,city2Y) in CityList:
                PheromoneTrailList[city1-1][city2-1] = ((1-self.Rou)*PheromoneTrailList[city1-1][city2-1] +
                                                    PheromoneDeltaTrailList[city1-1][city2-1])
                PheromoneDeltaTrailList[city1-1][city2-1] = 0
    
class ANT:
    def __init__(self, currCity = 0):
        self.TabuCitySet = sets.Set()            
        self.TabuCityList = []                   
        self.AllowedCitySet = sets.Set()         
        self.TransferProbabilityList = []        
        self.CurrCity = 0                       
        self.CurrLen = 0.0                      
        self.AddCity(currCity)
        pass
    def SelectNextCity(self, alpha, beta):
        if len(self.AllowedCitySet) == 0:
            return (0)
        sumProbability = 0.0
        for city in self.AllowedCitySet:
            sumProbability = sumProbability + (pow(PheromoneTrailList[self.CurrCity-1][city-1], alpha)* pow(1.0/CityDistanceList[self.CurrCity-1][city-1], beta))
        self.TransferProbabilityList = []
        for city in self.AllowedCitySet:
            transferProbability = (pow(PheromoneTrailList[self.CurrCity-1][city-1], alpha)* pow(1.0/CityDistanceList[self.CurrCity-1][city-1], beta))/sumProbability
            self.TransferProbabilityList.append((city, transferProbability))
        select = 0.0
        for city,cityProb in self.TransferProbabilityList:
            if cityProb > select:
                select = cityProb
        threshold = select * random.random()
        for (cityNum, cityProb) in self.TransferProbabilityList:
            if cityProb >= threshold:
                return (cityNum)
        return (0)
    def MoveToNextCity(self, alpha, beta):
        nextCity = self.SelectNextCity(alpha, beta)
        if nextCity > 0:
            self.AddCity(nextCity)
    def ClearTabu(self):
        self.TabuCityList = []
        self.TabuCitySet.clear()
        self.AllowedCitySet = CitySet - self.TabuCitySet
    def UpdatePathLen(self):
        for city in self.TabuCityList[0:-1]:
            nextCity = self.TabuCityList[self.TabuCityList.index(city)+1]
            self.CurrLen = self.CurrLen + CityDistanceList[city-1][nextCity-1]
        lastCity = self.TabuCityList[-1]
        firstCity = self.TabuCityList[0]
        self.CurrLen = self.CurrLen + CityDistanceList[lastCity-1][firstCity-1]
    def AddCity(self,city):
        if city <= 0:
            return
        self.CurrCity = city
        self.TabuCityList.append(city)
        self.TabuCitySet.add(city)
        self.AllowedCitySet = CitySet - self.TabuCitySet

citydic={}
for i in range(len(Cities)):
    citydic[i+1]=[i+1,rs.PointCoordinates(Cities[i])[0],rs.PointCoordinates(Cities[i])[1]]
cCount=len(Cities)
antCount=int(antCount)
nMax=int(nMax)
if run==True:
    theant=BACA(cityCount=cCount, antCount=antCount, q=80,alpha=2, beta=5, rou=0.3, nMax=nMax)
    theant.ReadCityInfo(citydic)
    theant.Search()
    BTCO=BTC[-1]
    closep=BTCO[:]
    closep.append(BTCO[0])
    Route=[Cities[i-1] for i in closep ]
# ---------- end aco ----------
construct_domain = ConstructDomain(DomainStart=aco_domain_start, DomainEnd=aco_domain_end)
custom_preview = CustomPreview(Geometry=boundary_surfaces, Shader=ColourSwatch(SwatchColor=RGBA(36, 162, 255, 133)))
list_length = ListLength(List=aco.Route)
random = Random(Range=construct_domain, Number=list_length, Seed=aco_seed)
unit_z = UnitZ(Factor=random)
move = Move(Geometry=aco.Route, Motion=unit_z)  # -> Geometry, Transform
polyline = PolyLine(Vertices=move.Geometry, Closed=False)
custom_preview_2 = CustomPreview(Geometry=polyline, Shader=ColourSwatch(SwatchColor=RGB(158, 144, 144)))

explode = Explode(Curve=polyline, Recursive=True)  # -> Segments, Vertices
divide_curve = DivideCurve(Curve=设计边界, Count=边界点数, Kinks=False)  # -> Points, Tangents, Parameters
graft_tree = GraftTree(Tree=地形山顶_山谷, IncludeEmptyLists=True, IncludeNullItems=True)
list_length_2 = ListLength(List=地形山顶_山谷)
boundary_surfaces_2 = BoundarySurfaces(Edges=设计边界)
unit_z_2 = UnitZ(Factor=1)
unit_z_3 = UnitZ(Factor=1)
unit_z_4 = UnitZ(Factor=1)
line_charge = LineCharge(Line=explode.Segments, Charge=控制折线强度, Bounds=设计边界)
random_2 = Random(Range=控制点强度区间, Number=list_length_2, Seed=控制点强度区间_seed)  # -> graft(Random)
random_3 = Random(Range=控制点衰减区间, Number=list_length_2, Seed=控制点衰减_seed)  # -> graft(Random)
populate_geometry_2 = PopulateGeometry(Geometry=boundary_surfaces_2, Count=populate_pts_count, Seed=populate_pts_seed)
reverse = Reverse(Vector=unit_z_4)
entwine = Entwine(Branch00=unit_z_3, Branch01=reverse, FlattenInputs=True)
point_charge = PointCharge(Point=graft_tree, Charge=random_2, Decay=random_3, Bounds=设计边界)
construct_domain_2 = ConstructDomain(DomainStart=Slider(-1, range=-20..50), DomainEnd=Slider(1, range=0..50))
unit_z_5 = UnitZ(Factor=抬升地形)
boolean_toggle = BooleanToggle(True)
merge = Merge(Data1=line_charge, Data2=point_charge)  # -> flatten(Result)
merge_fields = MergeFields(Fields=merge)
evaluate_field = EvaluateField(Field=merge_fields, Point=populate_geometry_2)  # -> Tensor, Strength
bounds = Bounds(Numbers=evaluate_field.Strength)
deconstruct_domain = DeconstructDomain(Domain=bounds)  # -> Start, End
subtraction = Subtraction(A=deconstruct_domain.End, B=evaluate_field.Strength)
bounds_2 = Bounds(Numbers=subtraction)
bounding_box = BoundingBox(Content=设计边界, Plane=PlaneXY(0, 0, 0))  # -> Box, Box_2
remap_numbers = RemapNumbers(Value=subtraction, Source=bounds_2, Target=construct_domain_2)  # -> Mapped, Clipped
amplitude = Amplitude(Vector=evaluate_field.Tensor, Amplitude=remap_numbers.Mapped)
reverse_2 = Reverse(Vector=amplitude)
amplitude_2 = Amplitude(Vector=reverse_2, Amplitude=磁力倍数)
vector_display = VectorDisplay(Anchor=populate_geometry_2, Vector=amplitude_2)
move_2 = Move(Geometry=populate_geometry_2, Motion=amplitude_2)  # -> Geometry, Transform
move_3 = Move(Geometry=move_2.Geometry, Motion=unit_z_5)  # -> Geometry, Transform
direction_display = DirectionDisplay(Field=merge_fields, Section=bounding_box.Box, Samples=1000)
merge_2 = Merge(Data1=move_3.Geometry, Data2=divide_curve.Points)  # -> flatten(Result)
delaunay_mesh = DelaunayMesh(Points=merge_2, Plane=PlaneXY(0, 0, 0))
smooth_mesh = SmoothMesh(Mesh=delaunay_mesh, Strength=光滑地形, SkipNaked=True, Iterations=1)
project_point = ProjectPoint(Point=merge_2, Direction=entwine, Geometry=smooth_mesh)  # -> Point, Index
deconstruct = Deconstruct(Point=merge_2)  # -> XComponent, YComponent, ZComponent
clean_tree = CleanTree(RemoveNulls=boolean_toggle, RemoveInvalid=boolean_toggle, RemoveEmpty=boolean_toggle, Tree=project_point.Point)  # -> flatten(Tree)
cull_duplicates = CullDuplicates(Points=clean_tree, Tolerance=0.1, CullMode=3)  # -> Points, Indices, Valence
sort_list = SortList(Keys=deconstruct.ZComponent, ValuesValuesA=merge_2)  # -> Keys, ValuesValuesA
list_item = ListItem(List=sort_list.ValuesValuesA, Index="0", Wrap=True)
contour = Contour(Shape=smooth_mesh, Point=list_item, Direction=unit_z_2, Distance=等高线距离)
地形表面 = ClusterOutput(smooth_mesh)  # 输出地形Mesh面。
等高线 = ClusterOutput(contour)  # 输出地形等高线。
高程点 = ClusterOutput(cull_duplicates.Points)  # 高程点

# ==== cluster 地形构建重分类可视化: 地形构建-重分类可视化
高程点_列表 = ClusterInput()  # 输入高程点坐标，每组坐标放置于单独的路径分支之下。
重分类高程 = ClusterInput()  # 输入重分类高程的数值。
numbers_to_points = NumbersToPoints(Numbers=高程点_列表, Mask=4)  # -> flatten(Points)
deconstruct = Deconstruct(Point=numbers_to_points)  # -> XComponent, YComponent, ZComponent
division = Division(A=deconstruct.ZComponent, B=重分类高程)
round = Round(Number=division)  # -> Nearest, Floor, Ceiling
bounds = Bounds(Numbers=round.Floor)
高程点 = ClusterOutput(numbers_to_points)  # 高程点。
sort_list = SortList(Keys=deconstruct.ZComponent, ValuesValuesA=numbers_to_points)  # -> Keys, ValuesValuesA
delaunay_mesh = DelaunayMesh(Points=numbers_to_points, Plane=PlaneXY(0, 0, 0))
deconstruct_domain = DeconstructDomain(Domain=bounds)  # -> Start, End
等高线间距 = ClusterInput()  # 输入等高线间距。
gradient = Gradient(
    LowerLimit=deconstruct_domain.Start,
    UpperLimit=deconstruct_domain.End,
    Parameter=round.Floor,
    stops=[0: RGB(103, 0, 120), 0: RGB(210, 0, 118), 0: RGB(243, 57, 0), 0.0526: RGB(236, 27, 60), 0.5: RGB(1, 192, 229), 0.6: RGB(18, 178, 90), 0.7: RGB(79, 186, 8), 0.8: RGB(220, 237, 32), 0.93: RGB(247, 159, 20), 1: RGB(243, 57, 0)])
sort_list_2 = SortList(Keys=round.Floor, ValuesValuesA=gradient)  # -> Keys, ValuesValuesA
delete_consecutive = DeleteConsecutive(Set=sort_list_2.Keys, Wrap=False)  # -> Set, Count
delete_consecutive_2 = DeleteConsecutive(Set=sort_list_2.ValuesValuesA, Wrap=False)  # -> Set, Count
multiplication = Multiplication(A=delete_consecutive.Set, B=重分类高程)
mesh_colours = MeshColours(Mesh=delaunay_mesh, Colours=gradient)
list_item = ListItem(List=sort_list.ValuesValuesA, Index=0, Wrap=True)
图例标签 = ClusterOutput(multiplication)  # 用于Legend组件Tags输入端。
图例颜色 = ClusterOutput(delete_consecutive_2.Set)  # 用于Legend组件Colour输入端.
contour = Contour(Shape=delaunay_mesh, Point=list_item, Direction=Vector(0, 0, 1), Distance=等高线间距)
legend = Legend(Colour=delete_consecutive_2.Set, Tags=multiplication, LegendType=1)
等高线 = ClusterOutput(contour)  # 根据输入间距输出等高线。
地形表面 = ClusterOutput(mesh_colours)  # 根据输入高程点建立地形表面。

# ==== cluster 人参考定位随机旋转: 人尺度模型，定位点与随机朝向。

# ---- group: Cluster Input
定位点 = ClusterInput()  # 人位置定位点。

旋转_seed = ClusterInput()  # 人朝向随机种子。

# ----
list_length = ListLength(List=定位点)
construct_domain = ConstructDomain(DomainStart=Slider(0, range=0..360.001), DomainEnd=Slider(360, range=0..360))
human_1_65 = Mesh(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)
random = Random(Range=construct_domain, Number=list_length, Seed=旋转_seed)
人参考定位 = 人参考定位(人mesh=human_1_65, 定位点=定位点, 旋转=random)

# ---- group: Cluster Output
geometry = ClusterOutput(人参考定位)  # 人尺度参考Mesh模型。

# ==== cluster 高程值标注随机位置: 高程值标注-随机位置
number_slider = Slider(360, range=0..9000)
高程点位置_seed = ClusterInput()  # 高程点位置-Seed
等高线 = ClusterInput()  # 等高线
list_length = ListLength(List=flatten(等高线))
random = Random(Range="0 to 1", Number=list_length, Seed=高程点位置_seed)
evaluate_length = EvaluateLength(Curve=flatten(等高线), Length=random, Normalized=True)  # -> Point, Tangent, Parameter
deconstruct = Deconstruct(Point=evaluate_length.Point)  # -> XComponent, YComponent, ZComponent
points = ClusterOutput(evaluate_length.Point)  # Points
z值 = ClusterOutput(deconstruct.ZComponent)  # Z值
text_tag_3d = TextTag3D(Location=evaluate_length.Point, Text=deconstruct.ZComponent, Size=Slider(0.38, range=0..1), Justification=7)
dot_display = DotDisplay(Point=evaluate_length.Point, Colour=RGB(0, 0, 0), Size=Slider(0.1, range=0..1))

# ==== cluster 吸引子点线: 吸引子-点-线。根据点组和点线距离正弦函数关系配置参数。

# ---- group: Cluster Input
控制曲线 = ClusterInput()  # 由曲线建立吸引子。

控制点 = ClusterInput()  # 由点建立吸引子。

处理点组 = ClusterInput()  # 处理点组

norm_y = ClusterInput()  # Range of Influence for output Grid-Y direction。

# ---- group: Norm_y
norm_z = ClusterInput()  # Range of Influence for output Grid-Z direction。

# ---- group: Cluster Input
nozerob = ClusterInput()  # noZeroB

nozerov = ClusterInput()  # noZeroV

sin_period = ClusterInput()  # 正弦函数周期。

sin_shift = ClusterInput()  # 正弦函数偏移。

sin_amplitude = ClusterInput()  # 正弦函数振幅。

minv = ClusterInput()  # minV

# ----
point = Point(处理点组)
pi = Pi(Factor=1)
curve_closest_point = CurveCP(Point=graft(point), Curve=flatten(控制曲线))  # -> Point, Parameter, Distance
multiplication = Multiplication(A=pi, B=sin_period)
multiplication_2 = Multiplication(A=pi, B=sin_shift)
multiplication_3 = Multiplication(A=pi, B=sin_amplitude)
flatten_tree = FlattenTree(Data=curve_closest_point.Point, Path="{0}")
merge = Merge(Data1=flatten_tree, Data2=控制点)
closest_point = ClosestPoint(Point=point, Cloud=flatten(merge))  # -> ClosestPoint, CPIndex, Distance
normalization_0_1 = GhPythonScript(x=closest_point.Distance, y=norm_y, z=norm_z, noZeroB=nozerob, noZeroV=nozerov)  # -> out, A; inputs noZeroB: Boolean; same code as normalization_0_1
line = Line(StartPoint=point, EndPoint=closest_point.ClosestPoint)
sin = GhPythonScript(values=normalization_0_1.A, sin_period=multiplication, sin_shift=multiplication_2, sin_amplitude=multiplication_3)  # -> out, sin_y; inputs values: list; same code as sin
vector_2pt = Vector2Pt(PointA=point, PointB=closest_point.ClosestPoint, Unitize=True)  # -> Vector, Length
minimum_limit = GhPythonScript(x=sin.sin_y, minV=minv, noZeroB=nozerob, noZeroV=nozerov)  # -> out, A; inputs noZeroB: Boolean; same code as minimum_limit
numoutput = Number(minimum_limit.A)
bounds = Bounds(Numbers=flatten(numoutput))
remap_numbers = RemapNumbers(Value=numoutput, Source=bounds, Target="0 to 1")  # -> Mapped, Clipped

# ---- group: Cluster Output
吸引子强度__0_1 = ClusterOutput(remap_numbers.Mapped)  # 将吸引子强度映射到［０，１］值域。

吸引子强度 = ClusterOutput(minimum_limit.A)  # 吸引子强度。

向量 = ClusterOutput(vector_2pt.Vector)  # 处理点组与控制点和点组到控制曲线最近点的单元向量。

连接线 = ClusterOutput(line)  # 处理点组与控制点和点组到控制曲线最近点的连线。

# ==== cluster 辅助地形设计Kangaroo: 辅助地形设计-Kangaroo

# ---- group: Cluster Input
控制曲线 = ClusterInput()  # 由曲线建立吸引子。

控制点 = ClusterInput()  # 由点建立吸引子。

norm_y = ClusterInput()  # Range of Influence for output Grid-Y direction。

# ---- group: Norm_y
norm_z = ClusterInput()  # Range of Influence for output Grid-Z direction。

# ---- group: Cluster Input
nozerob = ClusterInput()  # noZeroB

nozerov = ClusterInput()  # noZeroV

sin_period = ClusterInput()  # 正弦函数周期。

sin_shift = ClusterInput()  # 正弦函数偏移。

sin_amplitude = ClusterInput()  # 正弦函数振幅。

minv = ClusterInput()  # minV

吸引子向量倍数 = ClusterInput()  # 吸引子向量倍数

吸引子_load_weighting = ClusterInput()  # 吸引子-Load_Weighting

z_up_load_weighting = ClusterInput()  # Z_up_Load_Weighting

地形边界 = ClusterInput()  # 地形边界

u_count = ClusterInput()  # U Count

v_count = ClusterInput()  # V Count

mesh_lengthfactor = ClusterInput()  # Mesh_LengthFactor

mesh_strength = ClusterInput()  # Mesh_Strength

边界点控制距离 = ClusterInput()  # 边界点控制距离

# ----
boolean_toggle = BooleanToggle(True)
boolean_toggle_2 = BooleanToggle(True)
divide_surface = DivideSurface(Surface=地形边界, UCount=u_count, VCount=v_count)  # -> Points, Normals, Parameters
unit_z = UnitZ(Factor=1)
curve_closest_point = CurveClosestPoint(Point=divide_surface.Points, Curve=地形边界)  # -> Point, Parameter, Distance
mesh_quad = MeshQuad(CornerA="0", CornerB="1", CornerC="3", CornerD="2")
smaller_than = SmallerThan(FirstNumber=curve_closest_point.Distance, SecondNumber=边界点控制距离)  # -> SmallerThan, OrEqualTo
clean_tree = CleanTree(RemoveNulls=boolean_toggle, RemoveInvalid=boolean_toggle, RemoveEmpty=boolean_toggle, Tree=divide_surface.Points)  # -> flatten(Tree)

# ---- group: Cluster
吸引子_点_线 = 吸引子点线(
    控制曲线=控制曲线,
    控制点=控制点,
    处理点组=clean_tree,
    norm_y=norm_y,
    norm_z=norm_z,
    nozerob=nozerob,
    nozerov=nozerov,
    sin_period=sin_period,
    sin_shift=sin_shift,
    sin_amplitude=sin_amplitude,
    minv=minv)  # -> 连接线, 向量, 吸引子强度, 吸引子强度__0_1

# ----
load = Load(Point=clean_tree, ForceVector=unit_z, Weighting=z_up_load_weighting)
pts2meshquad = Pts2MeshQuad(TreeData=divide_surface.Points)  # -> out, simplify(PLst); inputs TreeData: tree of GeometryBase
# ---------- pts2meshquad: Python ----------
"""Provides a scripting component.
    Inputs:
        TreeData: Tree型点数据
    Output:
        PLst: Mesh Quad型顶点格式"""

__author__ = "Richie Bao-西建大-山水比德产学研合作项目（参数化设计数字技术示范课程建设）"
__version__ = "2022.01.01"

ghenv.Component.Name = 'Pts2MeshQuad'
ghenv.Component.NickName = 'Pts2MeshQuad'
ghenv.Component.Description = '将Tree型点数据转换为Mesh的四边面顶点组织形式。'
ghenv.Component.Message = '0.0.1'
ghenv.Component.Category = 'Moths'
ghenv.Component.SubCategory = 'Data Organization'
ghenv.Component.AdditionalHelpFromDocStrings = '1'

import Rhino
import rhinoscriptsyntax as rs
from Grasshopper import DataTree
from Grasshopper.Kernel.Data import GH_Path
data=TreeData
branches=data.Branches
PT=DataTree[Rhino.Geometry.GeometryBase]()
def grouper(branches,dt):
    for m in range(len(branches)-1):
        a=branches[m]
        b=branches[m+1]
        for i in range(len(a)-1):
            lst=[]
            lst.append(b[i])
            lst.append(a[i])
            lst.append(b[i+1])
            lst.append(a[i+1])
            dt.AddRange(lst,GH_Path(m,i))
    return dt
PLst=grouper(branches,PT)
# ---------- end pts2meshquad ----------
cull_pattern = CullPattern(List=divide_surface.Points, CullPattern=smaller_than.SmallerThan)
clean_tree_2 = CleanTree(RemoveNulls=boolean_toggle_2, RemoveInvalid=boolean_toggle_2, RemoveEmpty=boolean_toggle_2, Tree=cull_pattern)
construct_mesh = ConstructMesh(Vertices=pts2meshquad.PLst, Faces=mesh_quad)
mesh_join = MeshJoin(Meshes=flatten(construct_mesh))
edgelengths = EdgeLengths(Mesh=mesh_join, LengthFactor=mesh_lengthfactor, Strength=mesh_strength)
anchor = Anchor(Point=clean_tree_2, Strength=10000)
show = Show(G=mesh_join)
multiplication = Multiplication(A=吸引子_点_线.吸引子强度__0_1, B=吸引子向量倍数)
amplitude = Amplitude(Vector=吸引子_点_线.向量, Amplitude=multiplication)
load_2 = Load(Point=clean_tree, ForceVector=amplitude, Weighting=吸引子_load_weighting)
entwine = Entwine(Branch00=edgelengths, Branch01=anchor, Branch02=show, Branch03=load, Branch04=load_2, FlattenInputs=True)
goalobjects = ClusterOutput(entwine)  # GoalObjects
边界固定点 = ClusterOutput(cull_pattern)  # 边界固定点

# ==== cluster 人参考定位
人mesh = ClusterInput()
定位点 = ClusterInput()
旋转 = ClusterInput()
graft_tree = GraftTree(Tree=人mesh, IncludeEmptyLists=True, IncludeNullItems=True)
deconstruct_mesh = DeconstructMesh(Mesh=graft_tree)  # -> Vertices, Faces, Colours, Normals
graft_tree_2 = GraftTree(Tree=定位点, IncludeEmptyLists=True, IncludeNullItems=True)
deconstruct = Deconstruct(Point=deconstruct_mesh.Vertices)  # -> XComponent, YComponent, ZComponent
sort_list = SortList(Keys=deconstruct.ZComponent, ValuesValuesA=deconstruct_mesh.Vertices)  # -> Keys, ValuesValuesA
graft_tree_3 = GraftTree(Tree=旋转, IncludeEmptyLists=True, IncludeNullItems=True)
list_item = ListItem(List=sort_list.ValuesValuesA, Index=0, Wrap=True)
vector_2pt = Vector2Pt(PointA=list_item, PointB=graft_tree_2, Unitize=False)  # -> Vector, Length
move = Move(Geometry=graft_tree, Motion=vector_2pt.Vector)  # -> Geometry, Transform
xy_plane = XYPlane(Origin=graft_tree_2)
radians = Radians(Degrees=graft_tree_3)
rotate = Rotate(Geometry=move.Geometry, Angle=radians, Plane=xy_plane)  # -> Geometry, Transform
人参考 = ClusterOutput(rotate.Geometry)
