# Grasshopper definition 1_1_01_hello world.gh (Grasshopper 1.0.7)
# plug-ins: Bifocals

# #连接字符串输出Hello world!
panel = Panel("Hello")
concatenate = Concatenate(FragmentA=panel, FragmentB=" world!")
panel_2 = Panel(concatenate)
panel_3 = Panel("将Panel组件单独作为文字记录的工具。")
